# Dynamo graph BangSample.dyn (Dynamo 2.12.0.5650)
# packages: Bang! 2021.4.3

warnings = Warnings("Highlighted elements are joined but...(154427)")
description = Bang.Revit.Elements.Warning.Description(warning=warnings)
failingElements = Bang.Revit.Elements.Warning.FailingElements(warning=warnings)
severity = Bang.Revit.Elements.Warning.Severity(warning=warnings)
boolean = BoolSelector(true)
getWarnings = Bang.Revit.Elements.WarningTools.GetWarnings(toggle=boolean)
